# Dynamo graph Task_1.dyn (Dynamo 3.5.0.8297)

# group: User inputs
sheet_name = StringInput("sheet name")  # graph input
number_of_sheets = DoubleInput(1000)  # graph input
sheet_number_prefix = StringInput("AAA_BB_CC")  # graph input
sheet_number_separator = StringInput("-")  # graph input
title_block_type = FamilyTypes("Title_Blocks_A1_Metric:Standard")  # graph input

# group: Creating and padding the sheet numbers
sequence = Sequence(amount=number_of_sheets)
string_from_object = FromObject(object=sequence)
padding = DoubleInput(4)
padding_char = StringInput("0")
padLeft = String.PadLeft(string=string_from_object, newLength=padding, padChars=padding_char)

# group: Adding the sheet prefix
number = DoubleInput(0)
concat = String.Concat(string0=sheet_number_prefix, string1=sheet_number_separator)
insert = String.Insert(string=padLeft, index=number, toInsert=concat)

# group: Sheet creation
byNameNumberTitleBlock = Sheet.ByNameNumberTitleBlock(sheetName=sheet_name, sheetNumber=insert, titleBlockFamilyType=title_block_type)
