# Dynamo graph Task_2.dyn (Dynamo 3.6.0.9395)

# group: User inputs
structural_column_type = StructuralColumnTypes("Column_CIP_60x60")  # graph input
x_offset = DoubleInput(250)  # graph input
number_of_grids_in_x = IntegerSlider(15, range=0..100 step 1)  # graph input
y_offset = DoubleInput(1000)  # graph input
number_of_grids_in_y = IntegerSlider(5, range=0..100 step 1)  # graph input
base_level = Levels("L0 - Ground Floor")  # graph input
top_offset_from_level = DoubleInput(800)  # graph input

# group: Creating grids
byCoordinates = Point.ByCoordinates()
mul = x_offset * number_of_grids_in_x
byCoordinates_2 = Point.ByCoordinates(x=mul)
byStartPointEndPoint = Line.ByStartPointEndPoint(startPoint=byCoordinates, endPoint=byCoordinates_2)
sequence = Sequence(start=y_offset, amount=number_of_grids_in_y, step=y_offset)
byCoordinates_3 = Vector.ByCoordinates(y=sequence)
translate = Geometry.Translate(geometry=byStartPointEndPoint, direction=byCoordinates_3)
byLine = Grid.ByLine(line=translate)
mul_2 = y_offset * number_of_grids_in_y
byCoordinates_4 = Point.ByCoordinates(y=mul_2)
byStartPointEndPoint_2 = Line.ByStartPointEndPoint(startPoint=byCoordinates, endPoint=byCoordinates_4)
sequence_2 = Sequence(start=x_offset, amount=number_of_grids_in_x, step=x_offset)
byCoordinates_5 = Vector.ByCoordinates(x=sequence_2)
translate_2 = Geometry.Translate(geometry=byStartPointEndPoint_2, direction=byCoordinates_5)
byLine_2 = Grid.ByLine(line=translate_2)
byLine_3 = Grid.ByLine(line=byStartPointEndPoint)
byLine_4 = Grid.ByLine(line=byStartPointEndPoint_2)
code_block = CodeBlock { "Name"; }
code_block_2 = CodeBlock { "A"; }
setParameterByName = Element.SetParameterByName(element=byLine_3, parameterName=code_block, value=code_block_2)
code_block_3 = CodeBlock { "1"; }
setParameterByName_2 = Element.SetParameterByName(element=byLine_4, parameterName=code_block, value=code_block_3)

# group: Grid intersection points
join = List.Join(list0=byLine, list1=byLine_2, list2=byLine_3, list3=byLine_4)
curve = Grid.Curve(grid=join)
intersect = Geometry.Intersect(geometry=curve, other=curve, lacing=CrossProduct)
flatten = List.Flatten(list=intersect)
type = Object.Type(object=flatten)
code_block_4 = CodeBlock { "Autodesk.DesignScript.Geometry.Point"; }
eq = type == code_block_4
filterByBoolMask = List.FilterByBoolMask(list=flatten, mask=eq)
uniqueItems = List.UniqueItems(list=filterByBoolMask.in)

# group: Column and column height
byPointAndLevel = FamilyInstance.ByPointAndLevel(familyType=structural_column_type, point=uniqueItems, level=base_level)
code_block_5 = CodeBlock { "Top Offset"; }
setParameterByName_3 = Element.SetParameterByName(element=byPointAndLevel, parameterName=code_block_5, value=top_offset_from_level)
