# Grasshopper definition Task_1.gh (Grasshopper 1.0.8)
# plug-ins: Rhino.Inside for Autodesk Revit

# ---- group: User inputs
amount_of_sheets = Slider(1000, range=1..1000)
sheet_name_prefix = Panel("AAA_BB_CC")
sheet_name_separator = Panel("-")
sheet_name = Panel("sheet name")

# ---- group: Creating the sheet numbers
series = Series(Start=0, Step=1, Count=amount_of_sheets)
expression = Expression(x=series, Expression="Format(\"{0:0000}\", x)")
concatenate = Concatenate(Fragment_A=sheet_name_prefix, A=sheet_name_separator, Fragment_B=expression)

# ---- group: Creating the sheets
add_sheet = AddSheet(SheetNumber=concatenate, SheetName=sheet_name, TrackingMode=2)
