# Grasshopper definition Task_2.gh (Grasshopper 1.0.8)
# plug-ins: Rhino.Inside for Autodesk Revit

# ---- group: User inputs
in_ex_sc_ll_columnrectangular = ElementTypePicker({"IN-EX_SC_LL_ColumnRectangular : Column_CIP_45x45": "5ef45843-2622-43bb-838d-e5219e446b48:c343ca00-5970-4cb0-928a-8d08c18eb96f-002d44f8", "IN-EX_SC_LL_ColumnRectangular : Column_CIP_45x45/2": "5ef45843-2622-43bb-838d-e5219e446b48:c343ca00-5970-4cb0-928a-8d08c18eb96f-002d44f6", "IN-EX_SC_LL_ColumnRectangular : Column_CIP_50x75": "5ef45843-2622-43bb-838d-e5219e446b48:c343ca00-5970-4cb0-928a-8d08c18eb96f-002d44f0", "IN-EX_SC_LL_ColumnRectangular : Column_CIP_50x75/4": "5ef45843-2622-43bb-838d-e5219e446b48:c343ca00-5970-4cb0-928a-8d08c18eb96f-002d44ee", "IN-EX_SC_LL_ColumnRectangular : Column_CIP_60x60": "5ef45843-2622-43bb-838d-e5219e446b48:c343ca00-5970-4cb0-928a-8d08c18eb96f-002d44f4", "IN-EX_SC_LL_ColumnRectangular : Column_CIP_60x60/5": "5ef45843-2622-43bb-838d-e5219e446b48:c343ca00-5970-4cb0-928a-8d08c18eb96f-002d44f2"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}, selected="IN-EX_SC_LL_ColumnRectangular : Column_CIP_60x60")
height_offset_from_base_level = Slider(800, range=1..10000)
levels_picker = LevelsPicker(<levels picker referenced from the Revit model>)
x_spacing = Slider(250, range=1..10000)
y_grids = Slider(10, range=1..20)
y_spacing = Slider(1000, range=1..10000)
x_grids = Slider(15, range=1..20)
grid = ElementTypePicker({"Grid : Circle": "5ef45843-2622-43bb-838d-e5219e446b48:ca25302b-18e6-40ba-afc9-74c009473f6d-000ff587", "Grid : Without Circle": "5ef45843-2622-43bb-838d-e5219e446b48:5ae9a4fb-21e1-4e3d-89ad-4209c182786f-002a102c"}, selected="Grid : Circle")

# ---- group: Grids creation
addition = Addition(A=x_grids, B=1)
addition_2 = Addition(A=y_grids, B=1)
multiplication = Multiplication(A=y_grids, B=y_spacing)
multiplication_2 = Multiplication(A=x_grids, B=x_spacing)
char_sequence = CharSequence(Count=addition, CharPool="ABCDEFGHIJKLMNOPQRSTUVWXYZ", Format="{0}")
construct_point = ConstructPoint(XCoordinate=0, YCoordinate=0, ZCoordinate=0)
construct_point_2 = ConstructPoint(XCoordinate=multiplication, YCoordinate=0, ZCoordinate=0)
series = Series(Start=0, Step=x_spacing, Count=addition)
series_2 = Series(Start=1, Step=1, Count=addition_2)
construct_point_3 = ConstructPoint(XCoordinate=0, YCoordinate=0, ZCoordinate=0)
construct_point_4 = ConstructPoint(XCoordinate=0, YCoordinate=multiplication_2, ZCoordinate=0)
series_3 = Series(Start=0, Step=y_spacing, Count=addition_2)
line = Line(StartPoint=construct_point, EndPoint=construct_point_2)
vector_xyz = VectorXYZ(XComponent=0, YComponent=series, ZComponent=0)  # -> Vector, Length
line_2 = Line(StartPoint=construct_point_3, EndPoint=construct_point_4)
vector_xyz_2 = VectorXYZ(XComponent=series_3, YComponent=0, ZComponent=0)  # -> Vector, Length
move = Move(Geometry=line, Motion=vector_xyz.Vector)  # -> Geometry, Transform
move_2 = Move(Geometry=line_2, Motion=vector_xyz_2.Vector)  # -> Geometry, Transform
add_grid = AddGrid(Curve=move.Geometry, Top=levels_picker, Name=char_sequence, Type=grid, TrackingMode=2)
add_grid_2 = AddGrid(Curve=move_2.Geometry, Top=levels_picker, Name=series_2, Type=grid, TrackingMode=2)

# ---- group: Intersections
line_line = LineLine(Line1=graft(add_grid), Line2=add_grid_2)  # -> ParamA, ParamB, flatten(PointA), PointB

# ---- group: Column creation
deconstruct = Deconstruct(Point=line_line.PointA)  # -> XComponent, YComponent, ZComponent
construct_point_5 = ConstructPoint(XCoordinate=deconstruct.XComponent, YCoordinate=deconstruct.YComponent, ZCoordinate=height_offset_from_base_level)
line_3 = Line(StartPoint=line_line.PointA, EndPoint=construct_point_5)
add_structural_column = AddStructuralColumn(Curve=line_3, Type=in_ex_sc_ll_columnrectangular, BaseLevel=levels_picker, TopLevel=levels_picker, TrackingMode=2)
